# Dynamo graph script.dyn (Dynamo 2.13.1.3887)

python_script = Python()  # CPython3; unwired: IN[0]
# ---------- python_script.python (61 lines) ----------
# Boilerplate text
import clr
import sys
sys.path.append('C:\Program Files (x86)\IronPython 2.7\Lib')

import System
from System import Array
from System.Collections.Generic import *


clr.AddReference("RevitServices")
import RevitServices
from RevitServices.Persistence import DocumentManager 
from RevitServices.Transactions import TransactionManager 

clr.AddReference("RevitAPI")

import Autodesk 
from Autodesk.Revit.DB import *
watch = []

# Current doc/app/ui
doc = DocumentManager.Instance.CurrentDBDocument

# Get CurveElement Ids:
id_inuse = []

curves_inuse = FilteredElementCollector(doc).OfClass(CurveElement)
converted_list = list(curves_inuse)

for ci in curves_inuse:
    styleid_inuse = ci.LineStyle.Id.IntegerValue
    id_inuse.append(styleid_inuse)

id_inuse = list(set(id_inuse))

# Get all line style by getting first item
first_item = converted_list[-1]
id_all = first_item.GetLineStyleIds()


#Ids to delete
ids_todelete = List[ElementId]()

for all_Id in id_all:
    style = doc.GetElement(all_Id)
    if style == None: continue 
    if style.Name[0] == "<": continue 
    if all_Id.IntegerValue in id_inuse: continue
    
    watch.append(style.Name)
    ids_todelete.Add(all_Id)
    
tr = Transaction(doc,'Purge unused line styles')
tr.Start()
doc.Delete(ids_todelete)
tr.Commit()
 
    
# Preparing output to Dynamo
OUT =  id_all
# ----------------------------------------
