# Dynamo graph Test.dyn (Dynamo 2.12.0.5650)

select_model_elements = DSModelElementsSelection()  # 3 picked in the model
levels = Levels("Ground Floor")
python_script = Python(IN[0]=select_model_elements, IN[1]=levels)  # IronPython2
# ---------- python_script.python (60 lines) ----------
# Load the Python Standard and DesignScript Libraries
import sys

import clr
clr.AddReference('ProtoGeometry')
from Autodesk.DesignScript.Geometry import *

# Import ToDSType(bool) extension method
clr.AddReference("RevitNodes")
import Revit
clr.ImportExtensions(Revit.Elements)

# Import geometry conversion extention methods
clr.ImportExtensions(Revit.GeometryConversion)

#import document manager and transaction manager
clr.AddReference("RevitServices")
import RevitServices
from RevitServices.Persistence import DocumentManager
from RevitServices.Transactions import TransactionManager

# import revitAPI
clr.AddReference("RevitAPI")
import Autodesk
from Autodesk.Revit.DB import *
from Autodesk.Revit.DB.Architecture import *

# glpbal revit objects
doc = DocumentManager.Instance.CurrentDBDocument

# The inputs to this node will be stored as a list in the IN variables.
dataEnteringNode = IN

# Place your code below this line
lines = UnwrapElement(IN[0])

level = UnwrapElement(IN[1])
levelId = level.Id

result = []

def MakeWall(geoCurve):
	newWall = Wall.Create(doc,geoCurve,levelId,False) 
	return newWall
	
dict = {}
	
	
with Transaction(doc, "DYN - Create Wall") as transaction:
	transaction.Start()
	for line in lines:
		geoCurve = line.GeometryCurve	
		if geoCurve.Length > 15:
			MakeWall(geoCurve)
			result.append(geoCurve.Length)
			newWall = dict[newWall.Id]
	transaction.Commit()

# Assign your output to the OUT variable.
OUT = dict
# ----------------------------------------
select_model_element = DSModelElementSelection()  # 1 picked in the model
