# Dynamo graph script.dyn (Dynamo 2.13.1.3887)
# packages: archi-lab.net 2023.213.1722, Genius Loci 2023.2.21, Data-Shapes 2022.2.103

# group: UI
code_block = CodeBlock { "Text to Model Lines"; "Run"; "Cancel"; }
string = StringInput("Enter text:")
string_2 = StringInput("HelloWorld")
boolean = BoolSelector(false)
textbox_data = Custom[TextBox Data](InputName=string, DefaultText=string_2, IsNumberEntry=boolean)  # package Data-Shapes; Create Data for TextBox input in UI.MultipleInputForm ++ . Check out www.data-shapes.net for more informations
boolean_2 = BoolSelector(true)
multipleinputform = Custom[MultipleInputForm ++](Description_optional=code_block.out0, ButtonText_optional=code_block.out1, Inputs=textbox_data, Toggle=boolean_2, CancelButtonText_optional=code_block.out2)  # package Data-Shapes; Create a form with multiple inputs. see www.data-shapes.net for tutorials and infos!
code_block_2 = CodeBlock(OUT=multipleinputform.User_Inputs) { OUT[0]; }

string_3 = StringInput("Ref. Level")
view_byname = Custom[View ByName](ViewName=string_3)  # package Genius Loci; Collect views by given name in the active or given document. Based on a Christian Gartland's script.
sketchPlane = View.SketchPlane(view=view_byname)
origin = Point.Origin()
X = Point.X(point=origin)
Y = Point.Y(point=origin)
number = DoubleInput(100)
get_model_text = Python()  # CPython3; unwired: IN[0]
# ---------- get_model_text.python (18 lines) ----------
import clr
clr.AddReference("RevitAPI")
from Autodesk.Revit.DB import *
clr.AddReference("RevitServices")
import RevitServices
from RevitServices.Persistence import DocumentManager

# Get the active document
doc = DocumentManager.Instance.CurrentDBDocument

# Get all the model text types
text_types = FilteredElementCollector(doc).OfClass(ModelTextType).ToElements()

# Extract the names of the text types
text_type_names = [tt.get_Parameter(BuiltInParameter.SYMBOL_NAME_PARAM).AsString() for tt in text_types]

# Output the text type names
OUT = text_types
# ----------------------------------------
firstItem = List.FirstItem(list=get_model_text)
byTextSketchPlaneAndPosition = ModelText.ByTextSketchPlaneAndPosition(text=code_block_2, sketchPlane=sketchPlane, xCoordinateInPlane=X, yCoordinateInPlane=Y, textDepth=number, modelTextType=firstItem)
geometry = Element.Geometry(element=byTextSketchPlaneAndPosition)
explode = Geometry.Explode(geometry=geometry)
perimeterCurves = Surface.PerimeterCurves(surface=explode)
code_block_3 = CodeBlock { 2; }
getItemAtIndex = List.GetItemAtIndex(list=perimeterCurves@L2, index=code_block_3)
code_block_4 = CodeBlock { 0.5; }
pointAtParameter = Curve.PointAtParameter(curve=getItemAtIndex, param=code_block_4)
Z = Point.Z(point=pointAtParameter)
code_block_5 = CodeBlock { 0; }
eq = Z == code_block_5
filterByBoolMask = List.FilterByBoolMask(list=getItemAtIndex, mask=eq)
flatten = List.Flatten(list=filterByBoolMask.in)
boundingBox = Geometry.BoundingBox(geometry=geometry)
toCuboid = BoundingBox.ToCuboid(boundingBox=boundingBox)
explode_2 = Geometry.Explode(geometry=toCuboid)
code_block_6 = CodeBlock { 1; }
getItemAtIndex_2 = List.GetItemAtIndex(list=explode_2@L2, index=code_block_6)
perimeterCurves_2 = Surface.PerimeterCurves(surface=getItemAtIndex_2)
code_block_7 = CodeBlock { 1; 2; }
getItemAtIndex_3 = List.GetItemAtIndex(list=perimeterCurves_2@L2, index=code_block_7.out0)
length = Curve.Length(curve=getItemAtIndex_3)
getItemAtIndex_4 = List.GetItemAtIndex(list=perimeterCurves_2@L2, index=code_block_7.out1)
length_2 = Curve.Length(curve=getItemAtIndex_4)
code_block_8 = CodeBlock(x=length, y=length_2) { -x/2; -y/2; }
translate = Geometry.Translate(geometry=flatten, xTranslation=code_block_8.out0, yTranslation=code_block_8.out1, lacing=Longest)
byCurve = ModelCurve.ByCurve(curve=translate)
passThrough = Custom[PassThrough](passThrough=byTextSketchPlaneAndPosition, waitFor=byCurve)  # package archi-lab.net; Ripped this off from Clockwork. Sorry Andy.
delete = Element.Delete(element=passThrough)
