# Dynamo graph script.dyn "keynote file path" (Dynamo 2.13.1.3887)

python_script = Python()  # CPython3; unwired: IN[0]
# ---------- python_script.python (30 lines) ----------
import clr

import os

import subprocess

import RevitServices
from RevitServices.Persistence import DocumentManager 

import Autodesk 
from Autodesk.Revit.DB import *

# Current doc/app/ui
doc = DocumentManager.Instance.CurrentDBDocument

#get KeynoteTable file path
keynoteTable = KeynoteTable.GetKeynoteTable(doc)

externalFileReference = keynoteTable.GetExternalFileReference()

path = externalFileReference.GetAbsolutePath()

path_visible = ModelPathUtils.ConvertModelPathToUserVisiblePath(path)

#Open .txt file
if os.path.exists(path_visible):
    subprocess.Popen(['notepad.exe', path_visible], shell=True)
    OUT = "Notepad opened"
else:
    OUT = "File not found"
# ----------------------------------------
