# Dynamo graph script.dyn (Dynamo 2.13.1.3887)

python_script = Python()  # CPython3; unwired: IN[0]
# ---------- python_script.python (73 lines) ----------
import clr

import sys
sys.path.append('C:\Program Files (x86)\IronPython 2.7\Lib')

import System
from System import Array
from System.Collections.Generic import *

clr.AddReference('ProtoGeometry')
from Autodesk.DesignScript.Geometry import *

clr.AddReference("RevitNodes")
import Revit
clr.ImportExtensions(Revit.Elements)
clr.ImportExtensions(Revit.GeometryConversion)

clr.AddReference("RevitServices")
import RevitServices
from RevitServices.Persistence import DocumentManager 
from RevitServices.Transactions import TransactionManager 

clr.AddReference("RevitAPI")
clr.AddReference("RevitAPIUI")

import Autodesk 
from Autodesk.Revit.DB import *
from Autodesk.Revit.UI import *

# Current doc/app/ui
doc = DocumentManager.Instance.CurrentDBDocument
uiapp = DocumentManager.Instance.CurrentUIApplication 
app = uiapp.Application 
uidoc = uiapp.ActiveUIDocument

# Get all view templates
TemplateIds_All = []

for view in FilteredElementCollector(doc).OfClass(View):
    if view.IsTemplate:
        TemplateIds_All.append(view.Id.IntegerValue)
        
 # Get view with templates
TemplateIds_InUse = []

for view in FilteredElementCollector(doc).OfClass(View):
    if view.IsTemplate:
        continue
        
    templateId = view.ViewTemplateId
    if templateId.IntegerValue != -1:
        TemplateIds_InUse.append(templateId.IntegerValue)
        
#Compare TemplateIds_All and TemplateIds_InUse to determine what view templates to delete
TemplateIds_ToDelete = List[ElementId]()

for idInt in TemplateIds_All:
    if idInt in TemplateIds_InUse:
        continue
    TemplateIds_ToDelete.Add(ElementId(idInt))

#Open transaction to delete revit element

TransactionManager.Instance.EnsureInTransaction(doc)
# your actions


doc.Delete(TemplateIds_ToDelete)


TransactionManager.Instance.TransactionTaskDone()
# Assign your output to the OUT variable.
OUT = TemplateIds_ToDelete
# ----------------------------------------
