# Dynamo graph script.dyn (Dynamo 2.13.1.3887)
# packages: Data-Shapes 2022.2.103, bimorphNodes 4.2.4, archi-lab.net 2023.213.1722

code_block = CodeBlock { "Duplicate Sheets"; "Run"; }
code_block_2 = CodeBlock { "Select Sheets"; }
categories = Categories("OST_Sheets")
all_elements_of_category = ElementsOfCategory(Category=categories)
get_Sheet_Number_Name = Python(IN[0]=all_elements_of_category)  # CPython3
# ---------- get_Sheet_Number_Name.python (62 lines) ----------
# Boilerplate text
import clr

import sys
sys.path.append('C:\Program Files (x86)\IronPython 2.7\Lib')

import System
from System import Array
from System.Collections.Generic import *

clr.AddReference('ProtoGeometry')
from Autodesk.DesignScript.Geometry import *

clr.AddReference("RevitNodes")
import Revit
clr.ImportExtensions(Revit.Elements)
clr.ImportExtensions(Revit.GeometryConversion)

clr.AddReference("RevitServices")
import RevitServices
from RevitServices.Persistence import DocumentManager 
from RevitServices.Transactions import TransactionManager 

clr.AddReference("RevitAPI")
clr.AddReference("RevitAPIUI")

import Autodesk 
from Autodesk.Revit.DB import *
from Autodesk.Revit.UI import *



# Current doc/app/ui
doc = DocumentManager.Instance.CurrentDBDocument
uiapp = DocumentManager.Instance.CurrentUIApplication 
app = uiapp.Application 
uidoc = uiapp.ActiveUIDocument

#Get Sheets
Sheets = UnwrapElement(IN[0])

#Get Sheet names and numbers
Sheet_Names = []
Sheet_Numbers = []
Sheet_All = []

for Names in Sheets:
    Sheet_Names.append(Names.Name)

for Numbers in Sheets: 
    Sheet_Param_Num = Numbers.LookupParameter("Sheet Number")
    Sheet_Number = Sheet_Param_Num.AsString()
    Sheet_Numbers.append(Sheet_Number)


combined_names_and_numbers = [str(num) + ' ' + name for num, name in zip(Sheet_Numbers, Sheet_Names)]

# Add combined name and number to the list
Sheet_All.extend(combined_names_and_numbers)

# Preparing output to Dynamo
OUT = Sheet_All
# ----------------------------------------
listview_data = Custom[Listview Data](InputName=code_block_2, Keys=get_Sheet_Number_Name, Values=all_elements_of_category)  # package Data-Shapes; Create data for ListView input in UI.MultiInputForm ++ . Check out www.data-shapes.net for more infos.
code_block_3 = CodeBlock { "Enter New Prefix"; " "; false; "Copy"; }
textbox_data = Custom[TextBox Data](InputName=code_block_3.out0, DefaultText=code_block_3.out3, IsNumberEntry=code_block_3.out2)  # package Data-Shapes; Create Data for TextBox input in UI.MultipleInputForm ++ . Check out www.data-shapes.net for more informations
list_create = List.Create(item0=listview_data, item1=textbox_data)
boolean = BoolSelector(true)
multipleinputform = Custom[MultipleInputForm ++](Description_optional=code_block.out0, ButtonText_optional=code_block.out1, Inputs=list_create, Toggle=boolean)  # package Data-Shapes; Create a form with multiple inputs. see www.data-shapes.net for tutorials and infos!
code_block_4 = CodeBlock(OUT=multipleinputform.User_Inputs) { OUT[0]; OUT[1]; }
boolean_2 = BoolSelector(true)
code_block_5 = CodeBlock { "_"; }
code_block_6 = CodeBlock(x=code_block_4.out1, y=code_block_5) { x + y; }
duplicate = Revit.Sheet.Duplicate(sheets=code_block_4.out0, run=boolean_2, duplicateWithViews=boolean_2, prefix=code_block_6)
passThrough = Custom[PassThrough](passThrough=duplicate.Sheet, waitFor=duplicate.Sheet)  # package archi-lab.net; Ripped this off from Clockwork. Sorry Andy.
code_block_7 = CodeBlock { "Sheet Name"; "Sheet Number"; }

# group: Rename_SheetName
sheetName = Sheet.SheetName(sheet=passThrough)
setParameterByName = Element.SetParameterByName(element=passThrough, parameterName=code_block_7.out0, value=sheetName)

# group: Rename_SheetNumber
sheetNumber = Sheet.SheetNumber(sheet=passThrough)
python_script = Python(IN[0]=sheetNumber)  # CPython3
# ---------- python_script.python (29 lines) ----------
# Load the Python Standard and DesignScript Libraries
import sys
import clr
clr.AddReference('ProtoGeometry')
from Autodesk.DesignScript.Geometry import *

# The inputs to this node will be stored as a list in the IN variables.
dataEnteringNode = IN

# Place your code below this line
def remove_letters(input_list):
    result_list = []

    for item in input_list:
        # Use isdigit() to check if the character is a digit
        number_part = ''.join(char for char in item if char.isdigit())
        
        # Convert the string of digits to an integer and add it to the result list
        result_list.append(int(number_part))

    return result_list

# Example usage:
input_list = IN[0] 
result = remove_letters(input_list)


# Assign your output to the OUT variable.
OUT = result
# ----------------------------------------
code_block_8 = CodeBlock(x=code_block_6, y=python_script) { x + y; }
setParameterByName_2 = Element.SetParameterByName(element=passThrough, parameterName=code_block_7.out1, value=code_block_8)
