# Dynamo graph script.dyn (Dynamo 2.13.1.3887)
# packages: Data-Shapes 2022.2.103, Crumple 2022.5.27

# group: Select a Revision
code_block = CodeBlock { "Select a Revision"; 0; true; }
element_types = ElementTypes("Revision")
all_elements_of_type = ElementsOfType(element_type=element_types)
name = Element.Name(element=all_elements_of_type)
dropdown_data = Custom[DropDown Data](InputName=code_block.out0, Keys=name, Values=all_elements_of_type, DefaultValueIndex=code_block.out1, Sorted_optional=code_block.out2)  # package Data-Shapes; Create data for DropDown input in UI.MultiInputForm ++ . Check out www.data-shapes.net for more infos.

# group: Select Sheet(s)
code_block_2 = CodeBlock { "Select Sheets"; 300; true; false; }
code_block_3 = CodeBlock { "Sheets"; }
byName = Category.ByName(name=code_block_3)
all_elements_of_category = ElementsOfCategory(Category=byName)
sheetNumber = Sheet.SheetNumber(sheet=all_elements_of_category)
sheetName = Sheet.SheetName(sheet=all_elements_of_category)
code_block_4 = CodeBlock(number=sheetNumber, name=sheetName) { number + ": " + name; }
listview_data = Custom[Listview Data](InputName=code_block_2.out0, Keys=code_block_4, Values=all_elements_of_category, Height_optionnal=code_block_2.out1, HilightInView_optionnal=code_block_2.out3, DisplayModeOnly_optionnal=code_block_2.out3, ShowElementCount_optionnal=code_block_2.out3, SortItems_optionnal=code_block_2.out2, ShowId_optionnal=code_block_2.out3)  # package Data-Shapes; Create data for ListView input in UI.MultiInputForm ++ . Check out www.data-shapes.net for more infos.

# group: Add or Remove
code_block_5 = CodeBlock { "Add or Remove:"; true; "Check to ADD Revision, Uncheck to REMOVE Revision"; }
boolean_input = Custom[Boolean input](InputName=code_block_5.out0, DefaultValue=code_block_5.out1, SideText=code_block_5.out2)  # package Data-Shapes; Creates a boolean input for UI.MultipleInputForm ++ . Check out www.data-shapes.net for more infos!

# group: UI
code_block_6 = CodeBlock { "Add Revisions to Sheets"; "Run"; "Cancel"; 1000; 600; 175; }
list_create = List.Create(item0=dropdown_data, item1=listview_data, item2=boolean_input)
boolean = BoolSelector(true)
multipleinputform = Custom[MultipleInputForm ++](Description_optional=code_block_6.out0, ButtonText_optional=code_block_6.out1, Inputs=list_create, Toggle=boolean, CancelButtonText_optional=code_block_6.out2, MaxHeight_optional=code_block_6.out3, Width_optional=code_block_6.out4, LabelWidth_optional=code_block_6.out5)  # package Data-Shapes; Create a form with multiple inputs. see www.data-shapes.net for tutorials and infos!

code_block_7 = CodeBlock(out=multipleinputform.User_Inputs) { out[0]; out[1]; out[2]; }
not_ = Not(x=code_block_7.out2)
sheets_revisionsremove = Custom[© Sheets.RevisionsRemove](sheets=code_block_7.out1, revisions=code_block_7.out0, runMe=not_)  # package Crumple; Given a list of sheets, attempt to remove given revisions from those sheets.
sheets_revisionsadd = Custom[© Sheets.RevisionsAdd](sheets=code_block_7.out1, revisions=code_block_7.out0, runMe=code_block_7.out2)  # package Crumple; Given a list of sheets, attempt to add the given revisions to each of those sheets.
count = List.Count(list=code_block_7.out1)
string_from_object = FromObject(object=count)
code_block_8 = CodeBlock(n=string_from_object) { "Script Completed"; n + " Sheets Updated"; }
ui_messenger = Custom[© UI.Messenger](title=code_block_8.out0, body=code_block_8.out1)  # package Crumple; Displays a message box with a title/body and OK/cancel button. If OK is selected, the third input's data will be passed through.
