# Dynamo graph script.dyn (Dynamo 2.13.1.3887)
# packages: Crumple 2022.5.27, Data-Shapes 2022.2.103, Clockwork for Dynamo 2.x 2.1.2, archi-lab.net 2023.213.1722

# group: UI_Select excel file
string = StringInput("Select Excel Document")
string_2 = StringInput("Next")
string_3 = StringInput("Select")
string_4 = StringInput("C:\Users\bryce\Desktop\Precedent\Ashley.extension\AshleyBIM.extension\SheetNaming.xlsx")
filepath_data = Custom[FilePath Data](InputName=string_3, DefaulPath=string_4)  # package Data-Shapes; Create filepath input for UI.MultipleInputForm ++ . Check out www.data-shapes.net for more infos !
list_create = List.Create(item0=filepath_data)
boolean = BoolSelector(true)
string_5 = StringInput("Cancel")
multipleinputform = Custom[MultipleInputForm ++](Description_optional=string, ButtonText_optional=string_2, Inputs=list_create, Toggle=boolean, CancelButtonText_optional=string_5)  # package Data-Shapes; Create a form with multiple inputs. see www.data-shapes.net for tutorials and infos!
code_block = CodeBlock(OUT=multipleinputform.User_Inputs) { OUT[0]; }

# group: UI_Select excel worksheet
string_6 = StringInput("Next")
string_7 = StringInput("Select Drawing Set")
worksheets = Custom[Excel.Worksheets](FilePath=code_block)  # package Data-Shapes; Gets worksheet names from specified Excel workbook.
list_create_2 = List.Create(item0=worksheets)
flatten = List.Flatten(list=list_create_2)
dropdown_data = Custom[DropDown Data](InputName=string_7, Keys=flatten, Values=flatten)  # package Data-Shapes; Create data for DropDown input in UI.MultiInputForm ++ . Check out www.data-shapes.net for more infos.
multipleinputform_2 = Custom[MultipleInputForm ++](ButtonText_optional=string_6, Inputs=dropdown_data, Toggle=boolean)
code_block_2 = CodeBlock(OUT=multipleinputform_2.User_Inputs) { OUT[0]; }

# group: Import and manage Excel data
file_from_path = FileObject(path=code_block)
boolean_2 = BoolSelector(true)
boolean_3 = BoolSelector(false)
importExcel = Data.ImportExcel(file=file_from_path, sheetName=code_block_2, readAsStrings=boolean_2, showExcel=boolean_3)
number = DoubleInput(1)
dropItems = List.DropItems(list=importExcel, amount=number)
transpose = List.Transpose(lists=dropItems)
number_2 = DoubleInput(0)
getItemAtIndex = List.GetItemAtIndex(list=transpose, index=number_2)
flatten_2 = List.Flatten(list=getItemAtIndex)
number_3 = DoubleInput(1)
getItemAtIndex_2 = List.GetItemAtIndex(list=transpose, index=number_3)
flatten_3 = List.Flatten(list=getItemAtIndex_2)
code_block_3 = CodeBlock { 2; }
getItemAtIndex_3 = List.GetItemAtIndex(list=transpose, index=code_block_3)

# group: UI: Select sheets
string_8 = StringInput("Batch Create Sheets")
string_9 = StringInput("Run")
string_10 = StringInput("select sheets")
code_block_4 = CodeBlock(na=flatten_2, nu=flatten_3) { na + ' ' + nu; }
code_block_5 = CodeBlock(na=flatten_2, nu=flatten_3, ss=getItemAtIndex_3) { na + ' ' + nu + ' ' + ss; }
listview_data = Custom[Listview Data](InputName=string_10, Keys=code_block_4, Values=code_block_5)  # package Data-Shapes; Create data for ListView input in UI.MultiInputForm ++ . Check out www.data-shapes.net for more infos.
string_11 = StringInput("Select Title Block")
string_12 = StringInput("Title Blocks")
byName = Category.ByName(name=string_12)
all_family_types_of_category = Custom[All Family Types Of Category](category=byName)  # package Clockwork for Dynamo 2.x; Gets all family types/symbols of a given category in the model.
number_4 = DoubleInput(0)
dropdown_data_2 = Custom[DropDown Data](InputName=string_11, Keys=all_family_types_of_category, Values=all_family_types_of_category, DefaultValueIndex=number_4)
list_create_3 = List.Create(item0=listview_data, item1=dropdown_data_2)
multipleinputform_3 = Custom[MultipleInputForm ++](Description_optional=string_8, ButtonText_optional=string_9, Inputs=list_create_3, Toggle=boolean)
code_block_6 = CodeBlock(OUT=multipleinputform_3.User_Inputs) { OUT[0]; OUT[1]; }

# group: Create Sheets
code_block_7 = CodeBlock { ' '; }
split = String.Split(string=code_block_6.out0, separator0=code_block_7)
transpose_2 = List.Transpose(lists=split)
code_block_8 = CodeBlock { 0; 1; 2; }
getItemAtIndex_4 = List.GetItemAtIndex(list=transpose_2, index=code_block_8.out1)
getItemAtIndex_5 = List.GetItemAtIndex(list=transpose_2, index=code_block_8.out0)
string_13 = StringInput("Sheets")
byName_2 = Category.ByName(name=string_13)
all_elements_of_category = ElementsOfCategory(Category=byName_2)
sheetNumber = Sheet.SheetNumber(sheet=all_elements_of_category)
python_script = Python(IN[0]=getItemAtIndex_5, IN[1]=sheetNumber)  # CPython3
# ---------- python_script.python (11 lines) ----------
nnum = IN[0] 
enum = IN[1]

for i in range(len(nnum)):
    if nnum[i] in enum:
        new_name = nnum[i] + '_copy'
        while new_name in enum or new_name in nnum:
            new_name += '_copy'
        nnum[i] = new_name

OUT = nnum
# ----------------------------------------
sheets_create = Custom[© Sheets.Create](ttb_type=code_block_6.out1, names=getItemAtIndex_4, numbers=python_script)  # package Crumple; Creates Revit sheets based on a list of names, numbers and a single Titleblock type.
getItemAtIndex_6 = List.GetItemAtIndex(list=transpose_2, index=code_block_8.out2)

# group: File Sheets
string_14 = StringInput("SheetSeries")
setParameterByName = Element.SetParameterByName(element=sheets_create.sheets, parameterName=string_14, value=getItemAtIndex_6)

# group: UI_Script completion message
string_15 = StringInput("Script completed")
count = List.Count(list=setParameterByName)
passThrough = Custom[PassThrough](passThrough=count, waitFor=setParameterByName)  # package archi-lab.net; Ripped this off from Clockwork. Sorry Andy.
string_from_object = FromObject(object=passThrough)
string_16 = StringInput("sheets succesfully created")
code_block_9 = CodeBlock(c=string_from_object, m=string_16) { c + ' ' + m; }
ui_messenger = Custom[© UI.Messenger](title=string_15, body=code_block_9)  # package Crumple; Displays a message box with a title/body and OK/cancel button. If OK is selected, the third input's data will be passed through.
end = Revit.Transaction.Transaction.End(input=ui_messenger)
