# Dynamo graph script.dyn (Dynamo 2.13.1.3887)
# packages: Data-Shapes 2022.2.103, archi-lab.net 2023.213.1722, Crumple 2022.5.27

code_block = CodeBlock { "Select Sheets"; }
code_block_2 = CodeBlock { "Next"; }

# group: Select Sheets
code_block_3 = CodeBlock { "Select Sheets"; }
categories = Categories("OST_Sheets")
all_elements_of_category = ElementsOfCategory(Category=categories)
sheetNumber = Sheet.SheetNumber(sheet=all_elements_of_category)
sheetName = Sheet.SheetName(sheet=all_elements_of_category)
code_block_4 = CodeBlock(x=sheetNumber, y=sheetName) { x + " - " +y; }
boolean = BoolSelector(false)
listview_data = Custom[Listview Data](InputName=code_block_3, Keys=code_block_4, Values=all_elements_of_category, ShowId_optionnal=boolean)  # package Data-Shapes; Create data for ListView input in UI.MultiInputForm ++ . Check out www.data-shapes.net for more infos.
code_block_5 = CodeBlock { 600; }

list_create = List.Create(item0=listview_data)
boolean_2 = BoolSelector(true)
code_block_6 = CodeBlock { "Cancel"; }
code_block_7 = CodeBlock { 600; }
multipleinputform = Custom[MultipleInputForm ++](Description_optional=code_block, ButtonText_optional=code_block_2, Inputs=list_create, Toggle=boolean_2, CancelButtonText_optional=code_block_6, Width_optional=code_block_7)  # package Data-Shapes; Create a form with multiple inputs. see www.data-shapes.net for tutorials and infos!
code_block_8 = CodeBlock(OUT=multipleinputform.User_Inputs) { OUT[0]; }
titleBlock = Sheet.TitleBlock(sheet=code_block_8)
flatten = List.Flatten(list=titleBlock)
code_block_9 = CodeBlock { "Select Available Parameter"; }
code_block_10 = CodeBlock { "Select parameter"; }
parameters = Element.Parameters(element=flatten)
get_common_items_between_lists = Python(IN[0]=parameters)  # CPython3
# ---------- get_common_items_between_lists.python (26 lines) ----------
# Load the Python Standard and DesignScript Libraries
import sys
import clr
clr.AddReference('ProtoGeometry')
from Autodesk.DesignScript.Geometry import *

# The inputs to this node will be stored as a list in the IN variables.
Param_Titleblocks = UnwrapElement(IN[0])

# Place your code below this line
def common_elements(*lists):
    # Extract names for comparison
    flattened_lists = [set(item.Name if hasattr(item, 'Name') else str(item) for item in sublist) for sublist in lists]
    
    # Use the intersection method to find common elements based on names
    common_set = set.intersection(*flattened_lists)
    
    # Filter the original elements based on the common names
    common_elements = [item for sublist in lists for item in sublist if (item.Name if hasattr(item, 'Name') else str(item)) in common_set]
    
    return common_elements

result = common_elements(*Param_Titleblocks)

# Assign your output to the OUT variable.
OUT = result
# ----------------------------------------
string_from_object = FromObject(object=get_common_items_between_lists)
code_block_11 = CodeBlock { " :"; }
split = String.Split(string=string_from_object, separator0=code_block_11)
code_block_12 = CodeBlock { 0; }
getItemAtIndex = List.GetItemAtIndex(list=split@L2, index=code_block_12)
specType = Parameter.SpecType(parameter=get_common_items_between_lists)
flatten_2 = List.Flatten(list=specType)
string = StringInput("Delete")
replaceNull = archilab.Lists.Lists.ReplaceNull(list=flatten_2, replacement=string)
ne = flatten_2 != replaceNull
filterByBoolMask = List.FilterByBoolMask(list=getItemAtIndex, mask=ne)
flatten_3 = List.Flatten(list=filterByBoolMask.out)
filterByBoolMask_2 = List.FilterByBoolMask(list=flatten_2, mask=ne)
string_from_object_2 = FromObject(object=filterByBoolMask_2.out)
flatten_4 = List.Flatten(list=string_from_object_2)
code_block_13 = CodeBlock { "="; }
split_2 = String.Split(string=flatten_4, separator0=code_block_13)
code_block_14 = CodeBlock { 1; }
getItemAtIndex_2 = List.GetItemAtIndex(list=split_2@L2, index=code_block_14)
code_block_15 = CodeBlock { 0; 1; -1; -1; }
remove = String.Remove(string=getItemAtIndex_2, startIndex=code_block_15.out0, count=code_block_15.out1)
remove_2 = String.Remove(string=remove, startIndex=code_block_15.out2, count=code_block_15.out3)
code_block_16 = CodeBlock(x=flatten_3, y=remove_2) { x + "__" + y; }
dropdown_data = Custom[DropDown Data](InputName=code_block_10, Keys=flatten_3, Values=code_block_16)  # package Data-Shapes; Create data for DropDown input in UI.MultiInputForm ++ . Check out www.data-shapes.net for more infos.
list_create_2 = List.Create(item0=dropdown_data)
passThrough = Custom[PassThrough](passThrough=boolean_2, waitFor=code_block_8)  # package archi-lab.net; Ripped this off from Clockwork. Sorry Andy.
multipleinputform_2 = Custom[MultipleInputForm ++](Description_optional=code_block_9, ButtonText_optional=code_block_2, Inputs=list_create_2, Toggle=passThrough, CancelButtonText_optional=code_block_6)
code_block_17 = CodeBlock(OUT=multipleinputform_2.User_Inputs) { OUT[0]; }
code_block_18 = CodeBlock { "__"; }
split_3 = String.Split(string=code_block_17, separator0=code_block_18)
code_block_19 = CodeBlock { 0; 1; }
getItemAtIndex_3 = List.GetItemAtIndex(list=split_3, index=code_block_19.out0)
code_block_20 = CodeBlock { "Enter new parameter value"; "Update"; }
getItemAtIndex_4 = List.GetItemAtIndex(list=split_3, index=code_block_19.out1)
code_block_21 = CodeBlock { "Yes/No"; }
eq = getItemAtIndex_4 == code_block_21
boolean_input = Custom[Boolean input]()  # package Data-Shapes; Creates a boolean input for UI.MultipleInputForm ++ . Check out www.data-shapes.net for more infos!
textbox_data = Custom[TextBox Data]()  # package Data-Shapes; Create Data for TextBox input in UI.MultipleInputForm ++ . Check out www.data-shapes.net for more informations
flow_ifthenelse = Custom[© Flow.IfThenElse](If=eq, Then=boolean_input, Else=textbox_data)  # package Crumple; A simple if/then/else logic gate. If true, you get the 'then' input, otherwise you get the 'else' input. Unlike the OOTB 'If' node, this one allows differing list sizes.
list_create_3 = List.Create(item0=flow_ifthenelse)
multipleinputform_3 = Custom[MultipleInputForm ++](Description_optional=code_block_20.out0, ButtonText_optional=code_block_20.out1, Inputs=list_create_3, Toggle=boolean_2, CancelButtonText_optional=code_block_6)
code_block_22 = CodeBlock(OUT=multipleinputform_3.User_Inputs) { OUT[0]; }
setParameterByName = Element.SetParameterByName(element=flatten, parameterName=getItemAtIndex_3, value=code_block_22)
watch = Watch(code_block_17)
code_block_23 = CodeBlock { "Yes/No"; }
