# Dynamo graph script.dyn (Dynamo 2.13.1.3887)
# packages: Data-Shapes 2022.2.103, archi-lab.net 2023.213.1722, Crumple 2022.5.27

# group: Get Viewports
categories = Categories("OST_Sheets")
all_elements_of_category = ElementsOfCategory(Category=categories)
# note: UI Toggle
get_all_viewport_types = Custom[Get All Viewport Types]()  # package archi-lab.net; This node will retrieve all Viewport Types currently in the model.
code_block = CodeBlock(t7=all_elements_of_category, t10=get_all_viewport_types)
# ---------- code_block.designscript (17 lines) ----------
t4 = t7;
str1 = Elements.Views.Sheet.SheetNumber(t4);
str2 = Elements.Views.Sheet.SheetName(t4);
t1 = str1;
t2 = str2;
t3 = (t1 + "-") + t2;
str3 = "Select Sheets";
str4 = "Batch Change Viewport Labels";
str5 = "Cancel";
t5 = false;
element1 = Sheets.Viewports(t4);
t8 = List.Flatten(element1, -1);
t9 = true;
str6 = "Type";
viewports = t10;
t6 = viewports.Name;
str7 = "Next";
# ----------------------------------------
listview_data = Custom[Listview Data](InputName=code_block.str3, Keys=code_block.t3, Values=all_elements_of_category, ShowId_optionnal=code_block.t5)  # package Data-Shapes; Create data for ListView input in UI.MultiInputForm ++ . Check out www.data-shapes.net for more infos.
code_block_2 = CodeBlock(t1=listview_data) { t2 = [t1]; }
multipleinputform = Custom[MultipleInputForm ++](Description_optional=code_block.str4, ButtonText_optional=code_block.str7, Inputs=code_block_2, Toggle=code_block.t9, CancelButtonText_optional=code_block.str5)  # package Data-Shapes; Create a form with multiple inputs. see www.data-shapes.net for tutorials and infos!

# group: Change "Type" Parameter
code_block_3 = CodeBlock(t6=multipleinputform.User_Inputs)
# ---------- code_block_3.designscript (10 lines) ----------
OUT = t6;
t5 = Get.ValueAtIndex(OUT, 0);
t1 = t5;
element1 = Sheets.Viewports(t1);
str1 = "Type";
t2 = List.Flatten(element1, -1);
t3 = Elements.Element.GetParameterValueByName(t2, str1);
t4 = List.UniqueItems(t3);
str2 = "Select Viewport Label";
str3 = "Change";
# ----------------------------------------
dropdown_data = Custom[DropDown Data](InputName=code_block_3.str2, Keys=code_block.t6, Values=get_all_viewport_types)  # package Data-Shapes; Create data for DropDown input in UI.MultiInputForm ++ . Check out www.data-shapes.net for more infos.
code_block_4 = CodeBlock(t1=dropdown_data) { t2 = [t1]; }
multipleinputform_2 = Custom[MultipleInputForm ++](Description_optional=code_block.str4, ButtonText_optional=code_block_3.str3, Inputs=code_block_4, Toggle=code_block.t9, CancelButtonText_optional=code_block.str5)
code_block_5 = CodeBlock(OUT=multipleinputform_2.User_Inputs) { OUT[0]; "Type"; }
code_block_6 = CodeBlock(element3=code_block_3.element1, str3=code_block_5.out1, t2=code_block_5.out0)
# ---------- code_block_6.designscript (8 lines) ----------
element1 = element3;
str1 = str3;
t1 = t2;
element2 = Elements.Element.SetParameterByName(element1, str1, t1);
element11 = element2;
num1 = List.Count(element11);
Msg = num1 + " viewport labels changed";
str2 = "Complete";
# ----------------------------------------
ui_messenger = Custom[© UI.Messenger](title=code_block_6.str2, body=code_block_6.Msg)  # package Crumple; Displays a message box with a title/body and OK/cancel button. If OK is selected, the third input's data will be passed through.
