# Dynamo graph script.dyn (Dynamo 2.13.1.3887)
# packages: Data-Shapes 2022.2.103, bimorphNodes 4.2.4, archi-lab.net 2023.213.1722, spring nodes 210.1.1, Clockwork for Dynamo 2.x 2.1.2

# group: UI: Filter sheet selection
string = StringInput("Sheets")
byName = Category.ByName(name=string)
all_elements_of_category = ElementsOfCategory(Category=byName)
string_2 = StringInput("Next")
string_3 = StringInput("Filter Sheets:")
string_4 = StringInput("SheetSeries")
getParameterValueByName = Element.GetParameterValueByName(element=all_elements_of_category, parameterName=string_4)
code_block = CodeBlock { "1.0_PresentationDrawings"; "2.0_HOADrawings"; "3.0_TenderDrawings"; "4.0_LocalAuthority"; }
list_create = List.Create(item0=code_block.out0, item1=code_block.out1, item2=code_block.out2, item3=code_block.out3)
python_script = Python(IN[0]=getParameterValueByName, IN[1]=list_create)  # CPython3
# ---------- python_script.python (9 lines) ----------
p_ss = IN[0]
a_ss = IN[1]
s_ss = []

for i in p_ss:
    if i in a_ss:
        s_ss.append(i)

OUT = s_ss
# ----------------------------------------
dropdown_data = Custom[DropDown Data](InputName=string_3, Keys=python_script, Values=python_script)  # package Data-Shapes; Create data for DropDown input in UI.MultiInputForm ++ . Check out www.data-shapes.net for more infos.
boolean = BoolSelector(true)
string_5 = StringInput("Cancel")
multipleinputform = Custom[MultipleInputForm ++](ButtonText_optional=string_2, Inputs=dropdown_data, Toggle=boolean, CancelButtonText_optional=string_5)  # package Data-Shapes; Create a form with multiple inputs. see www.data-shapes.net for tutorials and infos!
code_block_2 = CodeBlock(OUT=multipleinputform.User_Inputs) { OUT[0]; }
sheetNumber = Sheet.SheetNumber(sheet=all_elements_of_category)

# group: UI: Select sheets and new series
string_6 = StringInput("Run")
string_7 = StringInput("Sheets to duplicate")
eq = code_block_2 == getParameterValueByName
filterByBoolMask = List.FilterByBoolMask(list=all_elements_of_category, mask=eq)
sheetNumber_2 = Sheet.SheetNumber(sheet=filterByBoolMask.in)
sheetName = Sheet.SheetName(sheet=filterByBoolMask.in)
code_block_3 = CodeBlock(nu=sheetNumber_2, na=sheetName) { nu + " " + na; }
boolean_2 = BoolSelector(false)
listview_data = Custom[Listview Data](InputName=string_7, Keys=code_block_3, Values=filterByBoolMask.in, ShowId_optionnal=boolean_2)  # package Data-Shapes; Create data for ListView input in UI.MultiInputForm ++ . Check out www.data-shapes.net for more infos.
string_8 = StringInput("Select new series")
dropdown_data_2 = Custom[DropDown Data](InputName=string_8, Keys=list_create, Values=list_create)
list_create_2 = List.Create(item0=listview_data, item1=dropdown_data_2)
string_9 = StringInput("Cancel")
multipleinputform_2 = Custom[MultipleInputForm ++](ButtonText_optional=string_6, Inputs=list_create_2, Toggle=boolean, CancelButtonText_optional=string_9)
code_block_4 = CodeBlock(OUT=multipleinputform_2.User_Inputs) { OUT[0]; OUT[1]; }

# group: Duplicate and file sheet selection
boolean_3 = BoolSelector(true)
string_10 = StringInput("Copy")
duplicateSheet = Sheet.DuplicateSheet(sheet=code_block_4.out0, duplicateWithContents=boolean_3, duplicateWithView=boolean_3, prefix=string_10)
setParameterByName = Element.SetParameterByName(element=duplicateSheet, parameterName=string_4, value=code_block_4.out1)

# group: Renumber Sheets
passThrough = Custom[PassThrough](passThrough=setParameterByName, waitFor=setParameterByName)  # package archi-lab.net; Ripped this off from Clockwork. Sorry Andy.
code_block_5 = CodeBlock { ["P", "H", "T", "LA"]; }
firstItem = List.FirstItem(list=code_block_4.out1)
code_block_6 = CodeBlock { 1; }
length = String.Length(string=firstItem)
code_block_7 = CodeBlock(count=length, srtin=code_block_6) { count - srtin; }
remove = String.Remove(string=firstItem, startIndex=code_block_6, count=code_block_7)
toNumber = String.ToNumber(string=remove)
code_block_8 = CodeBlock(ind=toNumber) { ind - 1; }
getItemAtIndex = List.GetItemAtIndex(list=code_block_5, index=code_block_8)
sheetNumber_3 = Sheet.SheetNumber(sheet=setParameterByName)
python_script_2 = Python(IN[0]=sheetNumber_3)  # CPython3
# ---------- python_script_2.python (11 lines) ----------
def get_numbers_only(lst):
    numbers_lst = []
    for string in lst:
        numbers = ''.join(filter(str.isdigit, string))
        numbers_lst.append(numbers)
    return numbers_lst

# Example usage
original_lst = IN[0]
numbers_only_lst = get_numbers_only(original_lst)
OUT = numbers_only_lst
# ----------------------------------------
code_block_9 = CodeBlock(pre=getItemAtIndex, nu=python_script_2) { pre + nu; }
python_script_3 = Python(IN[0]=code_block_9, IN[1]=sheetNumber)  # CPython3
# ---------- python_script_3.python (11 lines) ----------
nnum = IN[0] 
enum = IN[1]

for i in range(len(nnum)):
    if nnum[i] in enum:
        new_name = nnum[i] + '_copy'
        while new_name in enum or new_name in nnum:
            new_name += '_copy'
        nnum[i] = new_name

OUT = nnum
# ----------------------------------------
sheetName_2 = Sheet.SheetName(sheet=setParameterByName)
renumberRename = Revit.Sheet.RenumberRename(sheet=passThrough, number=python_script_3, name=sheetName_2)

# group: Rename Views
passthrough = Custom[Passthrough](passThrough=duplicateSheet, waitFor=renumberRename)  # package Clockwork for Dynamo 2.x; Forces a sequential order of execution. The node wired into the output of the Passthrough node will be executed *after* the node wired into the waitFor input (e.g. important for some Revit operations). The value of the passThrough input will be passed on to the node wired into the output port of the Passthrough node.
ꟿ_sheet_views = Custom[ꟿ Sheet.Views+](sheet=passthrough)  # package spring nodes; Extracts all views and schedules (minus the revision schedule) placed on the input sheet (or sheets). Will be depreciated once the bult in node works with all plan types.
string_11 = StringInput("View Name")
getParameterValueByName_2 = Element.GetParameterValueByName(element=ꟿ_sheet_views.view_s, parameterName=string_11)
passThrough_2 = Custom[PassThrough](passThrough=ꟿ_sheet_views.view_s, waitFor=getParameterValueByName_2)
flatten = List.Flatten(list=passThrough_2)
string_12 = StringInput("View Name")
flatten_2 = List.Flatten(list=getParameterValueByName_2)
string_from_object = FromObject(object=flatten_2)
python_script_4 = Python(IN[0]=string_from_object)  # CPython3; same code as python_script_2
code_block_10 = CodeBlock { "_"; }
split = String.Split(string=string_from_object, separator0=code_block_10)
code_block_11 = CodeBlock { 1; }
getItemAtIndex_2 = List.GetItemAtIndex(list=split@L2, index=code_block_11)
code_block_12 = CodeBlock(pre=getItemAtIndex, num=python_script_4, Nam=getItemAtIndex_2) { pre + num + "_" + Nam; }
python_script_5 = Python(IN[0]=code_block_12, IN[1]=flatten_2)  # CPython3; same code as python_script_3
setParameterByName_2 = Element.SetParameterByName(element=flatten, parameterName=string_12, value=python_script_5)
