# Dynamo graph script.dyn (Dynamo 2.13.1.3887)
# packages: Clockwork for Dynamo 2.x 2.1.2, Data-Shapes 2022.2.103, archi-lab.net 2023.213.1722

code_block = CodeBlock { "Subregion to Floor"; true; "Cancel"; "Run"; }
code_block_2 = CodeBlock { "Select Floor Type"; "Select Subregion"; "Select"; true; }
categories = Categories("OST_Topography")
selectmodelelements_data = Custom[SelectModelElements Data](InputName=code_block_2.out1, ButtonText=code_block_2.out2, CategoryFilter=categories, SelectSingleElement=code_block_2.out3)  # package Data-Shapes; Creates a Revit element selection input for UI.MultipleInputForm++ . Check out www.data-shapes.net for more infos!
code_block_3 = CodeBlock { "Select Floor Type"; }
categories_2 = Categories("OST_Floors")
all_elements_of_category = ElementsOfCategory(Category=categories_2)
type = archilab.Revit.Elements.Elements.Type(element=all_elements_of_category)
dropdown_data = Custom[DropDown Data](InputName=code_block_3, Keys=type, Values=type)  # package Data-Shapes; Create data for DropDown input in UI.MultiInputForm ++ . Check out www.data-shapes.net for more infos.
code_block_4 = CodeBlock { "Offset from Subregion"; "50"; true; }
textbox_data = Custom[TextBox Data](InputName=code_block_4.out0, DefaultText=code_block_4.out1, IsNumberEntry=code_block_4.out2)  # package Data-Shapes; Create Data for TextBox input in UI.MultipleInputForm ++ . Check out www.data-shapes.net for more informations
list_create = List.Create(item0=selectmodelelements_data, item1=dropdown_data, item2=textbox_data)
boolean = BoolSelector(true)
multipleinputform = Custom[MultipleInputForm ++](Description_optional=code_block.out0, ButtonText_optional=code_block.out3, Inputs=list_create, Toggle=boolean, CancelButtonText_optional=code_block.out2)  # package Data-Shapes; Create a form with multiple inputs. see www.data-shapes.net for tutorials and infos!
code_block_5 = CodeBlock(OUT=multipleinputform.User_Inputs) { OUT[0]; OUT[1]; OUT[2]; }
points = Topography.Points(topography=code_block_5.out0)
ZAxis = Vector.ZAxis()
translate = Geometry.Translate(geometry=points, direction=ZAxis, distance=code_block_5.out2)
geometry = Element.Geometry(element=code_block_5.out0)
lastItem = List.LastItem(list=geometry)
faceVertices = Custom[Mesh.FaceVertices](mesh=lastItem)  # package Clockwork for Dynamo 2.x; Gets the vertices of each face of a given mesh
byPerimeterPoints = Surface.ByPerimeterPoints(points=faceVertices)
byJoinedSurfaces = PolySurface.ByJoinedSurfaces(surfaces=byPerimeterPoints)
perimeterCurves = Surface.PerimeterCurves(surface=byJoinedSurfaces)
byOriginNormal = Plane.ByOriginNormal()
code_block_6 = CodeBlock { 20000; }
offset = Plane.Offset(plane=byOriginNormal, dist=code_block_6)
pullOntoPlane = Curve.PullOntoPlane(curve=perimeterCurves, plane=offset)
code_block_7 = CodeBlock { "Levels"; }
byName = Category.ByName(name=code_block_7)
all_elements_of_category_2 = ElementsOfCategory(Category=byName)
firstItem = List.FirstItem(list=all_elements_of_category_2)
byOutlineTypeAndLevel = Floor.ByOutlineTypeAndLevel(outlineCurves=pullOntoPlane, floorType=code_block_5.out1, level=firstItem)
slabShapeByPoints = Custom[Floor.SlabShapeByPoints](points=translate, floor=byOutlineTypeAndLevel)  # package Clockwork for Dynamo 2.x; Transform a slab shape based on a list of Points
geometry_2 = Element.Geometry(element=slabShapeByPoints.floor)
