# Dynamo graph script.dyn (Dynamo 2.13.1.3887)
# packages: Clockwork for Dynamo 2.x 2.1.2, Data-Shapes 2022.2.103, Crumple 2022.5.27

string = StringInput("Select Typography")
string_2 = StringInput("Topography")
byName = Category.ByName(name=string_2)
boolean = BoolSelector(true)
selectmodelelements_data = Custom[SelectModelElements Data](InputName=string, CategoryFilter=byName, SelectSingleElement=boolean)  # package Data-Shapes; Creates a Revit element selection input for UI.MultipleInputForm++ . Check out www.data-shapes.net for more infos!
string_3 = StringInput("Select Floor Type")
string_4 = StringInput("Floors")
byName_2 = Category.ByName(name=string_4)
all_family_types_of_category = Custom[All Family Types Of Category](category=byName_2)  # package Clockwork for Dynamo 2.x; Gets all family types/symbols of a given category in the model.
dropdown_data = Custom[DropDown Data](InputName=string_3, Keys=all_family_types_of_category, Values=all_family_types_of_category)  # package Data-Shapes; Create data for DropDown input in UI.MultiInputForm ++ . Check out www.data-shapes.net for more infos.
string_5 = StringInput("Select Height")
string_6 = StringInput("9000")
boolean_2 = BoolSelector(true)
textbox_data = Custom[TextBox Data](InputName=string_5, DefaultText=string_6, IsNumberEntry=boolean_2)  # package Data-Shapes; Create Data for TextBox input in UI.MultipleInputForm ++ . Check out www.data-shapes.net for more informations
list_create = List.Create(item0=selectmodelelements_data, item1=dropdown_data, item2=textbox_data)
boolean_3 = BoolSelector(true)
multipleinputform = Custom[MultipleInputForm ++](Inputs=list_create, Toggle=boolean_3)  # package Data-Shapes; Create a form with multiple inputs. see www.data-shapes.net for tutorials and infos!
code_block = CodeBlock(OUT=multipleinputform.User_Inputs) { OUT[0]; OUT[1]; OUT[2]; }
points = Topography.Points(topography=code_block.out0)
byPoints = Topography.ByPoints(points=points)
translate = Geometry.Translate(geometry=points, zTranslation=code_block.out2)
mesh = Topography.Mesh(topography=byPoints)
faceVertices = Custom[Mesh.FaceVertices](mesh=mesh)  # package Clockwork for Dynamo 2.x; Gets the vertices of each face of a given mesh
byPerimeterPoints = Surface.ByPerimeterPoints(points=faceVertices)
byUnion = Surface.ByUnion(surfaces=byPerimeterPoints)
perimeterCurves = Surface.PerimeterCurves(surface=byUnion)
byOriginNormal = Plane.ByOriginNormal()
code_block_2 = CodeBlock { 5000; }
offset = Plane.Offset(plane=byOriginNormal, dist=code_block_2)
pullOntoPlane = Curve.PullOntoPlane(curve=perimeterCurves, plane=offset)
byJoinedCurves = PolyCurve.ByJoinedCurves(curves=pullOntoPlane)
string_7 = StringInput("Levels")
byName_3 = Category.ByName(name=string_7)
all_elements_of_category = ElementsOfCategory(Category=byName_3)
code_block_3 = CodeBlock { 0; }
getItemAtIndex = List.GetItemAtIndex(list=all_elements_of_category, index=code_block_3)
byOutlineTypeAndLevel = Floor.ByOutlineTypeAndLevel(outline=byJoinedCurves, floorType=code_block.out1, level=getItemAtIndex)
slabShapeByPoints = Custom[Floor.SlabShapeByPoints](points=translate, floor=byOutlineTypeAndLevel)  # package Clockwork for Dynamo 2.x; Transform a slab shape based on a list of Points
geometry = Element.Geometry(element=slabShapeByPoints.floor)
passthrough = Custom[Passthrough](passThrough=byPoints, waitFor=geometry)  # package Clockwork for Dynamo 2.x; Forces a sequential order of execution. The node wired into the output of the Passthrough node will be executed *after* the node wired into the waitFor input (e.g. important for some Revit operations). The value of the passThrough input will be passed on to the node wired into the output port of the Passthrough node.
elements_delete = Custom[© Elements.Delete](elements=passthrough)  # package Crumple; Given a list of elements, attempt to delete them and then return true or false depending on whether it could be deleted. This script flattens the list structure before attempting.
