# Dynamo graph script.dyn (Dynamo 2.13.1.3887)
# packages: Clockwork for Dynamo 2.x 2.1.2, Data-Shapes 2022.2.103, archi-lab.net 2023.213.1722, Crumple 2022.5.27

string = StringInput("Select Typography")
string_2 = StringInput("Topography")
byName = Category.ByName(name=string_2)
boolean = BoolSelector(true)
selectmodelelements_data = Custom[SelectModelElements Data](InputName=string, CategoryFilter=byName, SelectSingleElement=boolean)  # package Data-Shapes; Creates a Revit element selection input for UI.MultipleInputForm++ . Check out www.data-shapes.net for more infos!
string_3 = StringInput("Select Floor Type")
string_4 = StringInput("Floors")
byName_2 = Category.ByName(name=string_4)
all_family_types_of_category = Custom[All Family Types Of Category](category=byName_2)  # package Clockwork for Dynamo 2.x; Gets all family types/symbols of a given category in the model.
dropdown_data = Custom[DropDown Data](InputName=string_3, Keys=all_family_types_of_category, Values=all_family_types_of_category)  # package Data-Shapes; Create data for DropDown input in UI.MultiInputForm ++ . Check out www.data-shapes.net for more infos.
list_create = List.Create(item0=selectmodelelements_data, item1=dropdown_data)
boolean_2 = BoolSelector(true)
multipleinputform = Custom[MultipleInputForm ++](Inputs=list_create, Toggle=boolean_2)  # package Data-Shapes; Create a form with multiple inputs. see www.data-shapes.net for tutorials and infos!
code_block = CodeBlock(OUT=multipleinputform.User_Inputs) { OUT[0]; OUT[1]; }
points = Topography.Points(topography=code_block.out0)
byPoints = Topography.ByPoints(points=points)
mesh = Topography.Mesh(topography=byPoints)
faceVertices = Custom[Mesh.FaceVertices](mesh=mesh)  # package Clockwork for Dynamo 2.x; Gets the vertices of each face of a given mesh
byPerimeterPoints = Surface.ByPerimeterPoints(points=faceVertices)
byUnion = Surface.ByUnion(surfaces=byPerimeterPoints)
perimeterCurves = Surface.PerimeterCurves(surface=byUnion)
byOriginNormal = Plane.ByOriginNormal()
code_block_2 = CodeBlock { 5000; }
offset = Plane.Offset(plane=byOriginNormal, dist=code_block_2)
pullOntoPlane = Curve.PullOntoPlane(curve=perimeterCurves, plane=offset)
byJoinedCurves = PolyCurve.ByJoinedCurves(curves=pullOntoPlane)
string_5 = StringInput("Levels")
byName_3 = Category.ByName(name=string_5)
all_elements_of_category = ElementsOfCategory(Category=byName_3)
code_block_3 = CodeBlock { 0; }
getItemAtIndex = List.GetItemAtIndex(list=all_elements_of_category, index=code_block_3)
byOutlineTypeAndLevel = Floor.ByOutlineTypeAndLevel(outline=byJoinedCurves, floorType=code_block.out1, level=getItemAtIndex)
slabShapeByPoints = Custom[Floor.SlabShapeByPoints](points=points, floor=byOutlineTypeAndLevel)  # package Clockwork for Dynamo 2.x; Transform a slab shape based on a list of Points
geometry = Element.Geometry(element=slabShapeByPoints.floor)
passThrough = Custom[PassThrough](passThrough=byPoints, waitFor=geometry)  # package archi-lab.net; Ripped this off from Clockwork. Sorry Andy.
elements_delete = Custom[© Elements.Delete](elements=passThrough)  # package Crumple; Given a list of elements, attempt to delete them and then return true or false depending on whether it could be deleted. This script flattens the list structure before attempting.
