# Dynamo graph script.dyn (Dynamo 2.13.1.3887)
# packages: Clockwork for Dynamo 2.x 2.1.2, Data-Shapes 2022.2.103, Crumple 2022.5.27

# group: uo
code_block = CodeBlock { "Subregion to Floor"; true; "Cancel"; "Run"; }
code_block_2 = CodeBlock { "Select Floor Type"; "Select Subregion"; "Select"; true; }
categories = Categories("OST_Topography")
selectmodelelements_data = Custom[SelectModelElements Data](InputName=code_block_2.out1, ButtonText=code_block_2.out2, CategoryFilter=categories, SelectSingleElement=code_block_2.out3)  # package Data-Shapes; Creates a Revit element selection input for UI.MultipleInputForm++ . Check out www.data-shapes.net for more infos!
string = StringInput("Select Material")
collect_materials = Custom[© Collect.Materials]()  # package Crumple; Returns all materials in the given document.
dropdown_data = Custom[DropDown Data](InputName=string, Keys=collect_materials.names, Values=collect_materials.materials)  # package Data-Shapes; Create data for DropDown input in UI.MultiInputForm ++ . Check out www.data-shapes.net for more infos.
list_create = List.Create(item0=selectmodelelements_data, item1=dropdown_data)
boolean = BoolSelector(true)
multipleinputform = Custom[MultipleInputForm ++](Description_optional=code_block.out0, ButtonText_optional=code_block.out3, Inputs=list_create, Toggle=boolean, CancelButtonText_optional=code_block.out2)  # package Data-Shapes; Create a form with multiple inputs. see www.data-shapes.net for tutorials and infos!
code_block_3 = CodeBlock(OUT=multipleinputform.User_Inputs) { OUT[0]; OUT[1]; }

# group: Make topo
geometry = Element.Geometry(element=code_block_3.out0)
lastItem = List.LastItem(list=geometry)
faceVertices = Custom[Mesh.FaceVertices](mesh=lastItem)  # package Clockwork for Dynamo 2.x; Gets the vertices of each face of a given mesh
byPerimeterPoints = Surface.ByPerimeterPoints(points=faceVertices)
byJoinedSurfaces = PolySurface.ByJoinedSurfaces(surfaces=byPerimeterPoints)
perimeterCurves = Surface.PerimeterCurves(surface=byJoinedSurfaces)
byOriginNormal = Plane.ByOriginNormal()
code_block_4 = CodeBlock { 20000; }
offset = Plane.Offset(plane=byOriginNormal, dist=code_block_4)
pullOntoPlane = Curve.PullOntoPlane(curve=perimeterCurves, plane=offset)
points = Topography.Points(topography=code_block_3.out0)
ZAxis = Vector.ZAxis()
pavingOffset = CodeBlock { 50; }
translate = Geometry.Translate(geometry=points, direction=ZAxis, distance=pavingOffset)
floorTypes = Custom[FloorTypes]()  # Retrieves all floor types from the active revit document
code_block_5 = CodeBlock { 0; }
getItemAtIndex = List.GetItemAtIndex(list=floorTypes, index=code_block_5)
byName = FloorType.ByName(name=getItemAtIndex)
code_block_6 = CodeBlock { "Levels"; }
byName_2 = Category.ByName(name=code_block_6)
all_elements_of_category = ElementsOfCategory(Category=byName_2)
firstItem = List.FirstItem(list=all_elements_of_category)
byOutlineTypeAndLevel = Floor.ByOutlineTypeAndLevel(outlineCurves=pullOntoPlane, floorType=byName, level=firstItem)
slabShapeByPoints = Custom[Floor.SlabShapeByPoints](points=translate, floor=byOutlineTypeAndLevel)  # package Clockwork for Dynamo 2.x; Transform a slab shape based on a list of Points
geometry_2 = Element.Geometry(element=slabShapeByPoints.floor)
string_2 = StringInput("Default Thickness")
getParameterValueByName = Element.GetParameterValueByName(element=byName, parameterName=string_2)

# group: Volronoi rectangle
byJoinedCurves = PolyCurve.ByJoinedCurves(curves=pullOntoPlane)
byPatch = Surface.ByPatch(closedCurve=byJoinedCurves)
boundingBox = Geometry.BoundingBox(geometry=byPatch)
toCuboid = BoundingBox.ToCuboid(boundingBox=boundingBox)
explode = Geometry.Explode(geometry=toCuboid)
code_block_7 = CodeBlock { 0.5; }
pointAtParameter = Surface.PointAtParameter(surface=explode, u=code_block_7, v=code_block_7)
ZAxis_2 = Vector.ZAxis()
byOriginNormal_2 = Plane.ByOriginNormal(origin=pointAtParameter, normal=ZAxis_2)
perimeterCurves_2 = Surface.PerimeterCurves(surface=explode)
length = Curve.Length(curve=perimeterCurves_2)
code_block_8 = CodeBlock(x=length) { x+300; }
maximumItem = List.MaximumItem(list=code_block_8)
byWidthLength = Rectangle.ByWidthLength(plane=byOriginNormal_2, width=maximumItem, length=maximumItem)
byPatch_2 = Surface.ByPatch(closedCurve=byWidthLength)

# group: get intersecting shapes with path
code_block_9 = CodeBlock(x=maximumItem) { x/20; }
randomList = Math.RandomList(amount=code_block_9)
randomList_2 = Math.RandomList(amount=code_block_9)
pointAtParameter_2 = Surface.PointAtParameter(surface=byPatch_2, u=randomList, v=randomList_2, lacing=Longest)
UVParameterAtPoint = Surface.UVParameterAtPoint(surface=byPatch_2, point=pointAtParameter_2, lacing=Longest)
byParametersOnSurface = Tessellation.Voronoi.ByParametersOnSurface(uvs=UVParameterAtPoint, face=byPatch_2)
ZAxis_3 = Vector.ZAxis()
code_block_10 = CodeBlock { 100; }
extrude = Curve.Extrude(curve=byParametersOnSurface, direction=ZAxis_3, distance=code_block_10)
code_block_11 = CodeBlock(X=code_block_10) { -X/2; }
translate_2 = Geometry.Translate(geometry=extrude, zTranslation=code_block_11)
byUnion = Surface.ByUnion(surfaces=translate_2)
split = Geometry.Split(geometry=byPatch_2, other=byUnion)
perimeterCurves_3 = Surface.PerimeterCurves(surface=split)
flatten = List.Flatten(list=split)
difference = Surface.Difference(surface=byPatch_2, others=byPatch)
code_block_12 = CodeBlock { 0; }
getItemAtIndex_2 = List.GetItemAtIndex(list=difference, index=code_block_12)
doesIntersect = Geometry.DoesIntersect(geometry=flatten, other=getItemAtIndex_2)
filterByBoolMask = List.FilterByBoolMask(list=flatten, mask=doesIntersect)
list_create_2 = List.Create(item0=filterByBoolMask.in)
byUnion_2 = Surface.ByUnion(surfaces=list_create_2)
Z = Point.Z(point=pointAtParameter)
Z_2 = Point.Z(point=points)
minimumItem = List.MinimumItem(list=Z_2)
code_block_13 = CodeBlock(x=Z, y=minimumItem, a=getParameterValueByName) { (x-y)+a; }
code_block_14 = CodeBlock(x=code_block_13) { -x; }
boolean_2 = BoolSelector(false)
thicken = Surface.Thicken(surface=byUnion_2, thickness=code_block_14, both_sides=boolean_2)
differenceAll = Solid.DifferenceAll(solid=geometry_2, others=thicken)
list_create_3 = List.Create(item0=filterByBoolMask.out)
perimeterCurves_4 = Surface.PerimeterCurves(surface=list_create_3)
reverse = Vector.Reverse(vector=ZAxis_3)
extrude_2 = Curve.Extrude(curve=perimeterCurves_4, direction=reverse, distance=code_block_13)
grouting = CodeBlock { 50; }
boolean_3 = BoolSelector(true)
thicken_2 = Surface.Thicken(surface=extrude_2, thickness=grouting, both_sides=boolean_3)
flatten_2 = List.Flatten(list=thicken_2)
differenceAll_2 = Solid.DifferenceAll(solid=differenceAll, others=flatten_2)

passthrough = Custom[Passthrough](passThrough=slabShapeByPoints.floor, waitFor=differenceAll_2)  # package Clockwork for Dynamo 2.x; Forces a sequential order of execution. The node wired into the output of the Passthrough node will be executed *after* the node wired into the waitFor input (e.g. important for some Revit operations). The value of the passThrough input will be passed on to the node wired into the output port of the Passthrough node.
delete = Element.Delete(element=passthrough)
categories_2 = Categories("OST_Floors")
byGeometry = DirectShape.ByGeometry(geometry=differenceAll_2, category=categories_2, material=code_block_3.out1)
