# Dynamo graph script.dyn "Visualisation_RoofProfile" (Dynamo 2.13.1.3887)
# packages: spring nodes 210.1.1, Data-Shapes 2022.2.103, Crumple 2022.5.27

string = StringInput("Roof Sheeting")
string_2 = StringInput("Run")
string_3 = StringInput("Select Faces")
string_4 = StringInput("Select")
selectfaces_data = Custom[SelectFaces Data](InputName=string_3, ButtonText=string_4)  # package Data-Shapes; Creates a Revit face selection input for UI.MultipleInputForm++. Check out www.data-shapes.net for more infos!
string_5 = StringInput("Select Profile")
string_6 = StringInput("IBR")
string_7 = StringInput("Standing Seam")
list_create = List.Create(item0=string_6, item1=string_7)
dropdown_data = Custom[DropDown Data](InputName=string_5, Keys=list_create, Values=list_create)  # package Data-Shapes; Create data for DropDown input in UI.MultiInputForm ++ . Check out www.data-shapes.net for more infos.
string_8 = StringInput("Select material")
collect_materials = Custom[© Collect.Materials]()  # package Crumple; Returns all materials in the given document.
dropdown_data_2 = Custom[DropDown Data](InputName=string_8, Keys=collect_materials.names, Values=collect_materials.materials)
list_create_2 = List.Create(item0=selectfaces_data, item1=dropdown_data, item2=dropdown_data_2)
boolean = BoolSelector(true)
multipleinputform = Custom[MultipleInputForm ++](Description_optional=string, ButtonText_optional=string_2, Inputs=list_create_2, Toggle=boolean)  # package Data-Shapes; Create a form with multiple inputs. see www.data-shapes.net for tutorials and infos!
code_block = CodeBlock(OUT=multipleinputform.User_Inputs) { OUT[0]; OUT[1]; OUT[2]; }

# group: Linework_HorizontalLines
perimeterCurves = Surface.PerimeterCurves(surface=code_block.out0)
startPoint = Curve.StartPoint(curve=perimeterCurves)
Z = Point.Z(point=startPoint)
endPoint = Curve.EndPoint(curve=perimeterCurves)
Z_2 = Point.Z(point=endPoint)
eq = Z == Z_2
filterByBoolMask = List.FilterByBoolMask(list=perimeterCurves, mask=eq)

list_create_3 = List.Create(item0=string_6, item1=string_7)
eq_2 = code_block.out1 == list_create_3
filterByBoolMask_2 = List.FilterByBoolMask(list=list_create, mask=eq_2)
eq_3 = filterByBoolMask_2.in == string_6
IBR = CodeBlock { 37; 35/2; 60/2; 171.5; }
standing_seam = CodeBlock { 65; 10/2; 12/2; 400; }
flow_ifthenelse = Custom[© Flow.IfThenElse](If=eq_3, Then=IBR.out3, Else=standing_seam.out3)  # package Crumple; A simple if/then/else logic gate. If true, you get the 'then' input, otherwise you get the 'else' input. Unlike the OOTB 'If' node, this one allows differing list sizes.
flow_ifthenelse_2 = Custom[© Flow.IfThenElse](If=eq_3, Then=IBR.out2, Else=standing_seam.out2)
flow_ifthenelse_3 = Custom[© Flow.IfThenElse](If=eq_3, Then=IBR.out0, Else=standing_seam.out0)
flow_ifthenelse_4 = Custom[© Flow.IfThenElse](If=eq_3, Then=IBR.out1, Else=standing_seam.out1)

# group: Linework_TopLine
startPoint_2 = Curve.StartPoint(curve=filterByBoolMask.in)
Z_3 = Point.Z(point=startPoint_2)
maximumItem = List.MaximumItem(list=Z_3)
eq_4 = Z_3 == maximumItem
filterByBoolMask_3 = List.FilterByBoolMask(list=startPoint_2, mask=eq_4)
code_block_2 = CodeBlock { 0; }
getItemAtIndex = List.GetItemAtIndex(list=flow_ifthenelse, index=code_block_2)

# group: Linework_BottomLine
endPoint_2 = Curve.EndPoint(curve=filterByBoolMask.in)
Z_4 = Point.Z(point=endPoint_2)
maximumItem_2 = List.MaximumItem(list=Z_4)
eq_5 = Z_4 == maximumItem_2
filterByBoolMask_4 = List.FilterByBoolMask(list=endPoint_2, mask=eq_5)
byStartPointEndPoint = Line.ByStartPointEndPoint(startPoint=filterByBoolMask_3.out, endPoint=filterByBoolMask_4.out)
length = Curve.Length(curve=byStartPointEndPoint)
code_block_3 = CodeBlock { 0; }
getItemAtIndex_2 = List.GetItemAtIndex(list=flow_ifthenelse, index=code_block_3)
code_block_4 = CodeBlock(x=length, y=getItemAtIndex_2) { x/y; }
code_block_5 = CodeBlock(x=code_block_4) { 0..1..#x; }
pointAtParameter = Curve.PointAtParameter(curve=byStartPointEndPoint, param=code_block_5)
reverse = List.Reverse(list=pointAtParameter@L2)
list_create_4 = List.Create(item0=reverse)

# group (continued): Linework_TopLine
byStartPointEndPoint_2 = Line.ByStartPointEndPoint(startPoint=filterByBoolMask_3.in, endPoint=filterByBoolMask_4.in)
length_2 = Curve.Length(curve=byStartPointEndPoint_2)
code_block_6 = CodeBlock(x=length_2, y=getItemAtIndex) { x/y; }
code_block_7 = CodeBlock(x=code_block_6) { 0..1..#x; }
pointAtParameter_2 = Curve.PointAtParameter(curve=byStartPointEndPoint_2, param=code_block_7)

# group: Linework_AngledLines
byStartPointEndPoint_3 = Line.ByStartPointEndPoint(startPoint=pointAtParameter_2@L2, endPoint=list_create_4@L2)
ꟿ_list_dropfirstlast = Custom[ꟿ List.DropFirstLast](list=byStartPointEndPoint_3@L2)  # package spring nodes; Removes the first and last items from the list

# group: Building Profile
list_create_5 = List.Create(item0=ꟿ_list_dropfirstlast.rest)
code_block_8 = CodeBlock { 0.5; }
pointAtParameter_3 = Curve.PointAtParameter(curve=list_create_5, param=code_block_8)
normalAtParameter = Curve.NormalAtParameter(curve=list_create_5, param=code_block_8)
code_block_9 = CodeBlock(x=flow_ifthenelse_2) { x; -x; }
byStartPointDirectionLength = Line.ByStartPointDirectionLength(startPoint=pointAtParameter_3, direction=normalAtParameter, length=code_block_9.x)
endPoint_3 = Curve.EndPoint(curve=byStartPointDirectionLength)
byStartPointDirectionLength_2 = Line.ByStartPointDirectionLength(startPoint=pointAtParameter_3, direction=normalAtParameter, length=code_block_9.out1)
endPoint_4 = Curve.EndPoint(curve=byStartPointDirectionLength_2)
byStartPointEndPoint_4 = Line.ByStartPointEndPoint(startPoint=endPoint_3, endPoint=endPoint_4)
flatten = List.Flatten(list=byStartPointEndPoint_4)
startPoint_3 = Curve.StartPoint(curve=list_create_5)
endPoint_5 = Curve.EndPoint(curve=list_create_5)
byTwoPoints = Vector.ByTwoPoints(start=startPoint_3, end=endPoint_5)
code_block_10 = CodeBlock { -90; }
rotate = Geometry.Rotate(geometry=byStartPointDirectionLength, origin=pointAtParameter_3, axis=byTwoPoints, degrees=code_block_10)
startPoint_4 = Curve.StartPoint(curve=rotate)
endPoint_6 = Curve.EndPoint(curve=rotate)
byTwoPoints_2 = Vector.ByTwoPoints(start=startPoint_4, end=endPoint_6)
byStartPointDirectionLength_3 = Line.ByStartPointDirectionLength(startPoint=pointAtParameter_3, direction=byTwoPoints_2, length=flow_ifthenelse_3)
endPoint_7 = Curve.EndPoint(curve=byStartPointDirectionLength_3)
code_block_11 = CodeBlock(x=flow_ifthenelse_4) { x; -x; }
byStartPointDirectionLength_4 = Line.ByStartPointDirectionLength(startPoint=endPoint_7, direction=normalAtParameter, length=code_block_11.x)
endPoint_8 = Curve.EndPoint(curve=byStartPointDirectionLength_4)
byStartPointEndPoint_5 = Line.ByStartPointEndPoint(startPoint=endPoint_3, endPoint=endPoint_8)
flatten_2 = List.Flatten(list=byStartPointEndPoint_5)
byStartPointDirectionLength_5 = Line.ByStartPointDirectionLength(startPoint=endPoint_7, direction=normalAtParameter, length=code_block_11.out1)
endPoint_9 = Curve.EndPoint(curve=byStartPointDirectionLength_5)
byStartPointEndPoint_6 = Line.ByStartPointEndPoint(startPoint=endPoint_4, endPoint=endPoint_9)
flatten_3 = List.Flatten(list=byStartPointEndPoint_6)
byStartPointEndPoint_7 = Line.ByStartPointEndPoint(startPoint=endPoint_8, endPoint=endPoint_9)
flatten_4 = List.Flatten(list=byStartPointEndPoint_7)
python_script = Python(IN[0]=flatten, IN[1]=flatten_2, IN[2]=flatten_3, IN[3]=flatten_4)  # CPython3
# ---------- python_script.python (14 lines) ----------
# T# The input lists
old_list1 = IN[0]
old_list2 = IN[1]
old_list3 = IN[2]
old_list4 = IN[3]

# Creating new lists
new_list1 = list(zip(old_list1, old_list2, old_list3, old_list4))
new_list2 = list(zip(old_list1, old_list2, old_list3, old_list4))
new_list3 = list(zip(old_list1, old_list2, old_list3, old_list4))
new_list4 = list(zip(old_list1, old_list2, old_list3, old_list4))

# Assigning the results to the OUT variables
OUT = new_list1, new_list2, new_list3, new_list4
# ----------------------------------------
byJoinedCurves = PolyCurve.ByJoinedCurves(curves=python_script, lacing=CrossProduct)
byPatch = Surface.ByPatch(closedCurve=byJoinedCurves)

# group: Solid Extrusions
length_3 = Curve.Length(curve=ꟿ_list_dropfirstlast.rest)
flatten_5 = List.Flatten(list=length_3)
boolean_2 = BoolSelector(true)
thicken = Surface.Thicken(surface=byPatch@L2, thickness=flatten_5, both_sides=boolean_2)
code_block_12 = CodeBlock { 3; }
boolean_3 = BoolSelector(false)
thicken_2 = Surface.Thicken(surface=code_block.out0, thickness=code_block_12, both_sides=boolean_3)

# group: Prepare and Export
flatten_6 = List.Flatten(list=thicken)
flatten_7 = List.Flatten(list=thicken_2)
union = Solid.Union(solid=flatten_6, solid_2=flatten_7, lacing=CrossProduct)
flatten_8 = List.Flatten(list=union)
byUnion = Solid.ByUnion(solids=flatten_8)
categories = Categories("OST_Roofs")
string_9 = StringInput("Dynamo Import")
byGeometry = DirectShape.ByGeometry(geometry=byUnion, category=categories, material=code_block.out2, name=string_9)
string_10 = StringInput("Roofing, Standing Seam")
byName = Material.ByName(name=string_10)
