# Dynamo graph script.dyn (Dynamo 2.13.1.3887)
# packages: Genius Loci 2023.2.21, Data-Shapes 2022.2.103, Crumple 2022.5.27

# group: Get_Hidden Elements
code_block = CodeBlock { t1 = archilab.Categories.GetAll(); t2 = Dictionary.ValueAtKey(t1, "Model"); }
all_elements_of_category = ElementsOfCategory(Category=code_block.t2)
code_block_2 = CodeBlock(t1=all_elements_of_category) { document1 = Document.Current; view1 = Document.ActiveView(document1); t2 = List.Flatten(t1, -1); }
get_hidden_element = Custom[Get Hidden Element](element=code_block_2.t2, view=code_block_2.view1)  # package Genius Loci; Reports the hidden elements in the given view.
getCategory = Element.GetCategory(element=get_hidden_element.Hidden_element)

# group: Ui 1
string_from_object = FromObject(object=getCategory)
code_block_3 = CodeBlock(t4=get_hidden_element.Hidden_element) { t2 = t4; t1 = [t2]; t3 = List.Flatten(t1, -1); num1 = Elements.Element.Id(t1); t5 = List.Flatten(num1, -1); }
string_from_object_2 = FromObject(object=code_block_3.t3)
code_block_4 = CodeBlock(t2=string_from_object, t3=string_from_object_2, t4=code_block_3.t5)
# ---------- code_block_4.designscript (7 lines) ----------
str1 = "Unhide";
str2 = "Cancel";
str3 = "Select Elements";
y = t2;
x = t3;
id = t4;
t1 = ((((y + ": ") + x) + " (") + id) + ")";
# ----------------------------------------
listview_data = Custom[Listview Data](InputName=code_block_4.str3, Keys=code_block_4.t1, Values=code_block_3.t5)  # package Data-Shapes; Create data for ListView input in UI.MultiInputForm ++ . Check out www.data-shapes.net for more infos.

# group: Toggle
boolean = BoolSelector(true)

# group: Ui 2
multipleinputform = Custom[MultipleInputForm ++](ButtonText_optional=code_block_4.str1, Inputs=listview_data, Toggle=boolean, CancelButtonText_optional=code_block_4.str2)  # package Data-Shapes; Create a form with multiple inputs. see www.data-shapes.net for tutorials and infos!
code_block_5 = CodeBlock(OUT=multipleinputform.User_Inputs) { OUT[0]; }
element_by_id = ElementById(Id=code_block_5)

# group: Ui 3
code_block_6 = CodeBlock(t4=element_by_id, view2=code_block_2.view1)
# ---------- code_block_6.designscript (9 lines) ----------
t3 = t4;
str1 = "Success";
t2 = t3;
num1 = List.Count(t2);
x = num1;
t1 = x + " Elements Unhidden";
view1 = view2;
t11 = t4;
bool1 = Views.UnHideElements(view1, t11);
# ----------------------------------------
ui_messenger = Custom[© UI.Messenger](title=code_block_6.str1, body=code_block_6.t1, pass=code_block_6.bool1)  # package Crumple; Displays a message box with a title/body and OK/cancel button. If OK is selected, the third input's data will be passed through.
