# Dynamo graph DeleteEmpty Tags.dyn (Dynamo 2.13.1.3887)

get_all_keynote_tags = Python()  # CPython3; unwired: IN[0]
# ---------- get_all_keynote_tags.python (50 lines) ----------
# Load the Python Standard and DesignScript Libraries
# Boilerplate text
import clr

import sys
sys.path.append('C:\Program Files (x86)\IronPython 2.7\Lib')

import System
from System import Array
from System.Collections.Generic import *

clr.AddReference('ProtoGeometry')
from Autodesk.DesignScript.Geometry import *

clr.AddReference("RevitNodes")
import Revit
clr.ImportExtensions(Revit.Elements)
clr.ImportExtensions(Revit.GeometryConversion)

clr.AddReference("RevitServices")
import RevitServices
from RevitServices.Persistence import DocumentManager 
from RevitServices.Transactions import TransactionManager 

clr.AddReference("RevitAPI")
clr.AddReference("RevitAPIUI")

import Autodesk 
from Autodesk.Revit.DB import *
from Autodesk.Revit.UI import *

# Current doc/app/ui
doc = DocumentManager.Instance.CurrentDBDocument
uiapp = DocumentManager.Instance.CurrentUIApplication 
app = uiapp.Application 
uidoc = uiapp.ActiveUIDocument


# Importing the necessary Revit API classes
from Autodesk.Revit.DB import FilteredElementCollector, BuiltInCategory, BuiltInParameter, Transaction

# Get the current Revit document
doc = DocumentManager.Instance.CurrentDBDocument

collector = FilteredElementCollector(doc).OfCategory(BuiltInCategory.OST_KeynoteTags).WhereElementIsNotElementType()
all_keynote_tags = list(collector)



OUT = all_keynote_tags
# ----------------------------------------
code_block = CodeBlock(t1=get_all_keynote_tags) { str1 = Tag.TagText(t1); }
string = StringInput("")
eq = code_block == string
filterByBoolMask = List.FilterByBoolMask(list=get_all_keynote_tags, mask=eq)
delete = Element.Delete(element=filterByBoolMask.in)
