# Dynamo graph DuplicateSheets.dyn (Dynamo 2.13.1.3887)
# packages: Data-Shapes 2022.2.103, bimorphNodes 4.2.4, archi-lab.net 2023.213.1722

string = StringInput("Select Sheets to Dublicate")
string_2 = StringInput("Sheets")
byName = Category.ByName(name=string_2)
all_elements_of_category = ElementsOfCategory(Category=byName)
sheetNumber = Sheet.SheetNumber(sheet=all_elements_of_category)
sheetName = Sheet.SheetName(sheet=all_elements_of_category)
code_block = CodeBlock(x=sheetNumber, y=sheetName) { x + ' '+ y; }
listview_data = Custom[Listview Data](InputName=string, Keys=code_block, Values=all_elements_of_category)  # package Data-Shapes; Create data for ListView input in UI.MultiInputForm ++ . Check out www.data-shapes.net for more infos.
string_3 = StringInput("Enter prefix")
code_block_2 = CodeBlock { ' '; }
boolean = BoolSelector(false)
textbox_data = Custom[TextBox Data](InputName=string_3, DefaultText=code_block_2, IsNumberEntry=boolean)  # package Data-Shapes; Create Data for TextBox input in UI.MultipleInputForm ++ . Check out www.data-shapes.net for more informations
list_create = List.Create(item0=listview_data, item1=textbox_data)
boolean_2 = BoolSelector(true)
multipleinputform = Custom[MultipleInputForm ++](Inputs=list_create, Toggle=boolean_2)  # package Data-Shapes; Create a form with multiple inputs. see www.data-shapes.net for tutorials and infos!
code_block_3 = CodeBlock(OUT=multipleinputform.User_Inputs) { OUT[0]; OUT[1]; }
boolean_3 = BoolSelector(true)
string_4 = StringInput("delete")
duplicate = Revit.Sheet.Duplicate(sheets=code_block_3.out0, run=boolean_3, duplicateWithViews=boolean_3, suffix=string_4)
sheetNumber_2 = Sheet.SheetNumber(sheet=duplicate.Sheet)
python_script = Python(IN[0]=sheetNumber_2)  # CPython3
# ---------- python_script.python (29 lines) ----------
# Load the Python Standard and DesignScript Libraries
import sys
import clr
clr.AddReference('ProtoGeometry')
from Autodesk.DesignScript.Geometry import *

# The inputs to this node will be stored as a list in the IN variables.
dataEnteringNode = IN

# Place your code below this line
def remove_letters(input_list):
    result_list = []

    for item in input_list:
        # Use isdigit() to check if the character is a digit
        number_part = ''.join(char for char in item if char.isdigit())
        
        # Convert the string of digits to an integer and add it to the result list
        result_list.append(int(number_part))

    return result_list

# Example usage:
input_list = IN[0] 
result = remove_letters(input_list)


# Assign your output to the OUT variable.
OUT = result
# ----------------------------------------
code_block_4 = CodeBlock(x=code_block_3.out1, y=python_script) { x + y; }
sheetName_2 = Sheet.SheetName(sheet=duplicate.Sheet)
renumberRename = Revit.Sheet.RenumberRename(sheet=duplicate.Sheet, number=code_block_4, name=sheetName_2)
passThrough = Custom[PassThrough]()  # package archi-lab.net; Ripped this off from Clockwork. Sorry Andy.; unwired: passThrough, waitFor
